# Grasshopper definition ewoodx_reader_sender.ghx (Grasshopper 1.0.8)

# ----
# Reader
trigger = Trigger(Interval=500, TimerInterval=500, Target=[timber_reader, projector_live_sender])  # disabled
connect = BooleanToggle(False)

path = FilePath("F:\07. IAAC_Internship & Works_2025-2026\16. eWoodX\circuloos_eWoodX\projector_runtime\")
timber_reader = Python3Script(
    json_path=path,
    connect=connect,
    refresh=Button(),
    index=Slider(0, range=0..100),
    capture=Button(),
    host="127.0.0.1",
    port="6203")  # -> status, timber_id, timber_contour, timber_corners, timber_holes, length_mm, width_mm, thickness_mm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; inputs json_path: String, refresh: Boolean, capture: Boolean, host: String, port: Int32
# ---------- timber_reader: Python ----------
"""
================================================================================
eWoodX - Grasshopper GhPython Component
Timber Reader + Stream Save Command
================================================================================

MEASUREMENT:
    Reads the latest modified measurement JSON from the selected
    projector runtime directory.

    Selects ONE timber using the existing index input.

COMMAND:
    Sends 'save' to the sensing agent through the central stream host.

    Uses eWoodX TCP framing:
        8-byte big-endian payload length + UTF-8 JSON

    Registers as a controller agent before sending commands.

GRASSHOPPER INPUTS:
    connect    : bool - Toggle (persistent stream connection)
    capture    : bool - Button (Save; requires connect=True)
    json_path  : str  - Projector runtime directory
    index      : int  - Selected timber index (default 0)
    host       : str  - Default 127.0.0.1
    port       : int  - Default 6203

GRASSHOPPER OUTPUTS:
    timber_contour
    timber_corners
    timber_holes
    timber_id
    length_mm
    width_mm
    thickness_mm
    surface_area_cm2
    side_lengths_mm
    color_rgb
    color_hex
    defects
    drawing_curves
    drawing_centers
    drawing_classes
    drawing_sizes
    drawing_confidences
    table_boundary
    markers_corners
    file_path
    status
    info

    ADDITIONAL OUTPUT:
    capture_id

OPTIONAL OUTPUT:
    raw_data

NOTES:
    - Connect a Grasshopper Timer set to 500 ms.
    - File polling does not require streaming.
    - The stream connection is only used for Save.
    - connect=True attempts registration once, then holds the connection.
    - connect=False closes the connection and resets the attempt.
    - A failed connection requires toggling False then True to retry.
    - The Button is deliberately NOT edge-detected.
    - A held True value can therefore send repeated Save commands.
    - Uses scriptcontext.sticky to preserve state between GH solutions.
================================================================================
"""

import os
import glob
import json
import socket
import time
import uuid
import threading
import datetime

try:
    import scriptcontext as sc
except ImportError:
    sc = None

try:
    import Rhino.Geometry as rg
    import System.Drawing as sd
    import Grasshopper
    from Grasshopper.Kernel.Data import GH_Path
    from Grasshopper import DataTree

    IN_RHINO = True
    HAS_DATATREE = True

except ImportError:
    rg = None
    sd = None
    DataTree = None
    GH_Path = None
    IN_RHINO = False
    HAS_DATATREE = False


# ============================================================
# CONFIGURATION
# ============================================================

FILE_PATTERN = "timber_*_measurement.json"

STREAM_HOST_DEFAULT = "127.0.0.1"
STREAM_PORT_DEFAULT = 6203

SENSING_AGENT_ID = "ewoodx_camera_01"

HEADER_SIZE = 8
CONNECT_TIMEOUT = 2.0
REGISTRATION_TIMEOUT = 3.0

# Must be different from the existing Python controller agent.
GH_AGENT_PREFIX = "ewoodx_gh_reader"

# Optional fallback when json_path is disconnected.
# Set this to your actual PROJECTOR_RUNTIME_ROOT if desired.
DEFAULT_RUNTIME_DIRECTORY = ""

# The Grasshopper Timer controls the actual polling interval.
# No internal timer is created.


# ============================================================
# GRASSHOPPER DATATREE
# ============================================================

def make_grafted_tree(items_per_timber):
    """
    Preserve the original grafted DataTree behavior.

    One selected timber produces branch {0}.
    """

    if not HAS_DATATREE or DataTree is None:
        return items_per_timber

    tree = DataTree[object]()

    for i, val in enumerate(items_per_timber):

        path = GH_Path(i)

        if isinstance(val, (list, tuple)):

            for sub_val in val:
                tree.Add(sub_val, path)

        elif val is not None:
            tree.Add(val, path)

    return tree


# ============================================================
# INPUT HELPERS
# ============================================================

def get_input(*names):
    """
    Read the first available Grasshopper input.
    """

    for name in names:

        value = globals().get(name, None)

        if value is not None:
            return value

    return None

def as_bool(value):
    """
    Convert Python Boolean, Grasshopper Boolean,
    DataTree, or single-item list into bool.
    """

    if value is None:
        return False

    # Grasshopper DataTree input
    if HAS_DATATREE and hasattr(value, "Branches"):
        try:
            if value.BranchCount > 0:
                branch = value.Branch(0)

                if len(branch) > 0:
                    return as_bool(branch[0])
        except Exception:
            return False

        return False

    # List or tuple input
    if isinstance(value, (list, tuple)):
        if len(value) > 0:
            return as_bool(value[0])

        return False

    # Python Boolean
    if isinstance(value, bool):
        return value

    # Numeric
    if isinstance(value, (int, float)):
        return bool(value)

    # String
    if isinstance(value, str):
        return value.strip().lower() in (
            "true", "1", "yes", "save", "capture"
        )

    return False


def as_int(value, default=0):

    try:
        return int(value)
    except (TypeError, ValueError):
        return default


# ============================================================
# RUNTIME JSON FILE SELECTION
# ============================================================

def resolve_latest_json(raw_input):
    """
    Select the latest modified measurement JSON.

    Selection does NOT depend on entity ID or filename number.

    Supports:
        - Directory path
        - Explicit JSON file path
        - Configured default runtime directory
    """

    if raw_input is None or not str(raw_input).strip():
        raw_input = DEFAULT_RUNTIME_DIRECTORY

    if not raw_input:
        return None

    path = os.path.abspath(
        os.path.expanduser(
            str(raw_input).strip().strip('"').strip("'")
        )
    )

    # Explicit file selection is supported.
    if os.path.isfile(path):

        if path.lower().endswith(".json"):
            return path

        return None

    if not os.path.isdir(path):
        return None

    candidates = glob.glob(
        os.path.join(path, FILE_PATTERN)
    )

    valid_files = []

    for candidate in candidates:

        try:
            stat = os.stat(candidate)

            if os.path.isfile(candidate):
                valid_files.append(
                    (stat.st_mtime_ns, candidate)
                )

        except OSError:
            continue

    if not valid_files:
        return None

    # Newest modification time wins.
    # Filename is only a deterministic tie-breaker.
    valid_files.sort(
        key=lambda item: (item[0], item[1]),
        reverse=True
    )

    return valid_files[0][1]


def file_signature(path):
    """
    Detect updates to the active runtime JSON.

    Same filename + different modification time => reload.
    New filename => reload.
    """

    stat = os.stat(path)

    return (
        os.path.abspath(path),
        stat.st_mtime_ns,
        stat.st_size
    )


# ============================================================
# PERSISTENT GRASSHOPPER STATE
# ============================================================

class ReaderState(object):

    def __init__(self):

        self.last_signature = None
        self.last_path = None
        self.root_data = None

        self.last_error = ""
        self.last_loaded_at = None

        self.client = None
        self.client_host = None
        self.client_port = None
        self.connect_attempted = False
        self.connection_error = ""


def get_component_key():
    """
    Unique key for this GH component instance.
    """

    try:
        return str(ghenv.Component.InstanceGuid)
    except Exception:
        return "ewoodx_gh_reader_default"


COMPONENT_KEY = get_component_key()

STATE_KEY = (
    "ewoodx_timber_reader_state_" + COMPONENT_KEY
)

if sc is not None:

    if STATE_KEY not in sc.sticky:
        sc.sticky[STATE_KEY] = ReaderState()

    state = sc.sticky[STATE_KEY]

else:
    state = ReaderState()


# ============================================================
# TCP STREAM CLIENT
# ============================================================

class GHSaveStreamClient(object):
    """
    Minimal eWoodX-compatible controller stream client.

    The socket stays connected between GH solutions.

    A background thread receives registration and
    command-result messages.

    Does not subscribe to measurement streams.
    """

    def __init__(self, host, port, agent_id):

        self.host = host
        self.port = int(port)
        self.agent_id = agent_id

        self.sock = None

        self.lock = threading.RLock()
        self.send_lock = threading.Lock()

        self.running = False
        self.registered = False

        self.registration_event = threading.Event()

        self.thread = None

        self.last_error = ""
        self.last_result = None
        self.last_request_id = None

        self.pending_requests = set()

    # --------------------------------------------------------
    # Framing
    # --------------------------------------------------------

    def _send_message(self, message):

        payload = json.dumps(
            message,
            allow_nan=False
        ).encode("utf-8")

        header = len(payload).to_bytes(
            HEADER_SIZE,
            byteorder="big"
        )

        with self.send_lock:

            if self.sock is None:
                raise ConnectionError(
                    "Stream socket is not connected."
                )

            self.sock.sendall(header + payload)

    def _recv_exact(self, size):

        chunks = []
        remaining = size

        while remaining > 0:

            chunk = self.sock.recv(remaining)

            if not chunk:
                raise ConnectionError(
                    "Stream socket closed."
                )

            chunks.append(chunk)
            remaining -= len(chunk)

        return b"".join(chunks)

    def _recv_message(self):

        header = self._recv_exact(HEADER_SIZE)

        size = int.from_bytes(
            header,
            byteorder="big"
        )

        if size <= 0 or size > 10 * 1024 * 1024:
            raise ValueError(
                "Invalid stream message size."
            )

        payload = self._recv_exact(size)

        return json.loads(
            payload.decode("utf-8")
        )

    # --------------------------------------------------------
    # Connection
    # --------------------------------------------------------

    def connect(self):

        with self.lock:

            if self.running:
                return

            self.registration_event.clear()
            self.registered = False
            self.last_error = ""

            sock = socket.socket(
                socket.AF_INET,
                socket.SOCK_STREAM
            )

            try:

                sock.settimeout(CONNECT_TIMEOUT)

                sock.connect(
                    (self.host, self.port)
                )

                # Persistent connection must not time out
                # while waiting for messages.
                sock.settimeout(None)

            except Exception:

                sock.close()
                raise

            self.sock = sock
            self.running = True

        self.thread = threading.Thread(
            target=self._receive_loop,
            daemon=True
        )

        self.thread.start()

        # Register as a controller agent.
        try:

            self._send_message({
                "type": "agent_register",
                "agent": {
                    "agent_id": self.agent_id,
                    "roles": ["controller"],
                    "metadata": {
                        "application": "grasshopper",
                        "component": "timber_reader"
                    }
                }
            })

            acknowledged = self.registration_event.wait(
                REGISTRATION_TIMEOUT
            )

            if not acknowledged:
                raise TimeoutError(
                    "Stream registration timed out."
                )

            with self.lock:

                if not self.registered:
                    raise ConnectionError(
                        self.last_error or
                        "Stream registration failed."
                    )

        except Exception:

            self.close()
            raise

    def close(self):

        with self.lock:

            self.running = False
            self.registered = False

            sock = self.sock
            self.sock = None

            self.registration_event.set()

        if sock is not None:

            try:
                sock.shutdown(socket.SHUT_RDWR)
            except Exception:
                pass

            try:
                sock.close()
            except Exception:
                pass

    # --------------------------------------------------------
    # Receive
    # --------------------------------------------------------

    def _receive_loop(self):

        try:

            while self.running:

                message = self._recv_message()

                message_type = message.get("type")

                if message_type == "agent_registered":

                    with self.lock:

                        if message.get("agent_id") == self.agent_id:

                            self.registered = True

                        else:

                            self.last_error = (
                                "Agent registration ID mismatch."
                            )

                    self.registration_event.set()

                elif message_type == "agent_rejected":

                    with self.lock:

                        self.registered = False

                        self.last_error = message.get(
                            "reason",
                            "Agent registration rejected."
                        )

                    self.registration_event.set()

                elif message_type == "ewoodx.command_result":

                    request_id = message.get(
                        "request_id"
                    )

                    with self.lock:

                        self.pending_requests.discard(
                            request_id
                        )

                        self.last_result = message

        except Exception as exc:

            with self.lock:

                if self.running:
                    self.last_error = str(exc)

        finally:
            self.close()

    # --------------------------------------------------------
    # Save
    # --------------------------------------------------------

    def send_save(self):

        with self.lock:

            if not self.running or not self.registered:
                raise ConnectionError(
                    "Controller stream is not registered."
                )

        request_id = str(uuid.uuid4())

        message = {
            "type": "ewoodx.command",
            "timestamp": time.time(),
            "target": SENSING_AGENT_ID,
            "request_id": request_id,
            "command": "save",
            "parameters": {}
        }

        self._send_message(message)
        print("[GH STREAM] SAVE COMMAND SENT")
        print(json.dumps(message, indent=2))

        with self.lock:

            self.pending_requests.add(request_id)
            self.last_request_id = request_id
            self.last_result = None

        return request_id

    def get_status(self):

        with self.lock:

            return {
                "connected": self.running,
                "registered": self.registered,
                "error": self.last_error,
                "result": self.last_result,
                "pending": len(self.pending_requests)
            }


# ============================================================
# STREAM CLIENT LIFECYCLE
# ============================================================

def get_stream_client(host, port):
    """
    Reuse the registered client across GH recomputations.

    Reconnect if the host/port changes or the connection
    has been lost.
    """

    client = state.client

    if client is not None:

        if (
            state.client_host != host
            or state.client_port != port
        ):

            client.close()
            client = None

        elif client.running and client.registered:

            return client

        else:

            client.close()
            client = None

    agent_id = (
        GH_AGENT_PREFIX
        + "_"
        + COMPONENT_KEY.replace("-", "")[:12]
    )

    client = GHSaveStreamClient(
        host=host,
        port=port,
        agent_id=agent_id
    )

    client.connect()

    state.client = client
    state.client_host = host
    state.client_port = port

    return client


# ============================================================
# SINGLE TIMBER PARSER
# ============================================================

def parse_single_timber(data, file_path):
    """
    Preserve the reference reader's geometry conversion.

    Reads one selected timber dictionary.
    """

    t_id = data.get(
        "timber_id",
        data.get("capture_id", 0)
    )

    l_mm = float(
        data.get("length_mm", 0.0)
    )

    w_mm = float(
        data.get("width_mm", 0.0)
    )

    th_mm = float(
        data.get(
            "timber_thickness_mm",
            data.get("thickness_mm", 0.0)
        )
    )

    sides = [
        float(s)
        for s in data.get("side_lengths_mm", [])
    ]

    if "surface_area_cm2" in data:

        area_cm2 = float(
            data["surface_area_cm2"]
        )

    elif "surface_area_mm2" in data:

        area_cm2 = (
            float(data["surface_area_mm2"]) / 100.0
        )

    else:

        area_cm2 = (
            l_mm * w_mm
        ) / 100.0

    # --------------------------------------------------------
    # Color
    # --------------------------------------------------------

    color_dict = data.get(
        "color_rgb",
        {}
    )

    r = int(color_dict.get("R", 200))
    g = int(color_dict.get("G", 160))
    b = int(color_dict.get("B", 120))

    c_hex = data.get(
        "color_hex",
        "#{:02x}{:02x}{:02x}".format(r, g, b)
    )

    if sd is not None:

        c_rgb = sd.Color.FromArgb(
            r, g, b
        )

    else:

        c_rgb = (r, g, b)

    # --------------------------------------------------------
    # Hand-drawn shapes
    # --------------------------------------------------------

    drawing_crvs = []
    drawing_centers_pts = []
    drawing_cls_names = []
    drawing_conf_vals = []
    drawing_sizes = []

    raw_drawings = data.get(
        "hand_drawn_shapes",
        []
    )

    for drw in raw_drawings:

        c_name = drw.get(
            "class_name",
            "unknown"
        )

        conf = float(
            drw.get("confidence", 0.0)
        )

        c_mm = drw.get(
            "center_mm",
            [0.0, 0.0]
        )

        corners_mm = drw.get(
            "bbox_corners_mm",
            []
        )

        w_d_mm = 0.0
        h_d_mm = 0.0

        if len(corners_mm) >= 4:

            dx1 = (
                corners_mm[1][0]
                - corners_mm[0][0]
            )

            dy1 = (
                corners_mm[1][1]
                - corners_mm[0][1]
            )

            w_d_mm = (
                dx1 ** 2 + dy1 ** 2
            ) ** 0.5

            dx2 = (
                corners_mm[2][0]
                - corners_mm[1][0]
            )

            dy2 = (
                corners_mm[2][1]
                - corners_mm[1][1]
            )

            h_d_mm = (
                dx2 ** 2 + dy2 ** 2
            ) ** 0.5

        shape_pts_mm = (
            drw.get("shape_points_mm")
            or drw.get("bbox_corners_mm", [])
        )

        if IN_RHINO and rg is not None:

            drawing_centers_pts.append(
                rg.Point3d(
                    float(c_mm[0]),
                    float(c_mm[1]),
                    0.0
                )
            )

            if len(shape_pts_mm) >= 3:

                d_pts = [
                    rg.Point3d(
                        float(p[0]),
                        float(p[1]),
                        0.0
                    )
                    for p in shape_pts_mm
                ]

                d_pts.append(d_pts[0])

                drawing_crvs.append(
                    rg.Polyline(
                        d_pts
                    ).ToPolylineCurve()
                )

            else:

                drawing_crvs.append(None)

        else:

            drawing_centers_pts.append(c_mm)
            drawing_crvs.append(shape_pts_mm)

        dim_info = drw.get(
            "dimensions_mm",
            {}
        )

        size_str = dim_info.get(
            "size_str",
            "{:.1f}x{:.1f}mm".format(
                w_d_mm,
                h_d_mm
            )
        )

        drawing_cls_names.append(c_name)
        drawing_conf_vals.append(conf)
        drawing_sizes.append(size_str)

    # --------------------------------------------------------
    # Timber geometry
    # --------------------------------------------------------

    contour_crv = None
    corners_pts = []
    defect_pts = []
    holes_crvs = []

    raw_holes = data.get(
        "holes_mm",
        data.get("inner_contours_mm", [])
    )

    raw_contour = data.get(
        "contour_mm",
        data.get("corners_mm", [])
    )

    if IN_RHINO and rg is not None:

        if raw_contour and len(raw_contour) >= 3:

            pts = [
                rg.Point3d(
                    float(p[0]),
                    float(p[1]),
                    0.0
                )
                for p in raw_contour
            ]

            pts.append(pts[0])

            contour_crv = (
                rg.Polyline(pts).ToPolylineCurve()
            )

        for h_pts_coords in raw_holes:

            if (
                h_pts_coords
                and len(h_pts_coords) >= 3
            ):

                h_pts = [
                    rg.Point3d(
                        float(p[0]),
                        float(p[1]),
                        0.0
                    )
                    for p in h_pts_coords
                ]

                h_pts.append(h_pts[0])

                holes_crvs.append(
                    rg.Polyline(
                        h_pts
                    ).ToPolylineCurve()
                )

        for c_pt in data.get(
            "corners_mm",
            []
        ):

            if len(c_pt) >= 2:

                corners_pts.append(
                    rg.Point3d(
                        float(c_pt[0]),
                        float(c_pt[1]),
                        0.0
                    )
                )

        for d in data.get(
            "defects",
            []
        ):

            if isinstance(d, dict):

                center = d.get(
                    "center_mm",
                    [0, 0]
                )

                dx = float(center[0])
                dy = float(center[1])

                defect_pts.append(
                    rg.Point3d(
                        dx, dy, 0.0
                    )
                )

            elif (
                isinstance(d, (list, tuple))
                and len(d) >= 2
            ):

                defect_pts.append(
                    rg.Point3d(
                        float(d[0]),
                        float(d[1]),
                        0.0
                    )
                )

    else:

        if raw_contour and len(raw_contour) >= 3:
            contour_crv = raw_contour

        holes_crvs = raw_holes

        corners_pts = data.get(
            "corners_mm",
            []
        )

        defect_pts = data.get(
            "defects",
            []
        )

    return {
        "timber_id": t_id,
        "length_mm": l_mm,
        "width_mm": w_mm,
        "thickness_mm": th_mm,
        "surface_area_cm2": area_cm2,
        "side_lengths_mm": sides,
        "color_rgb": c_rgb,
        "color_hex": c_hex,
        "contour": contour_crv,
        "holes": holes_crvs,
        "hole_count": len(holes_crvs),
        "corners": corners_pts,
        "defects": defect_pts,
        "drawing_curves": drawing_crvs,
        "drawing_centers": drawing_centers_pts,
        "drawing_classes": drawing_cls_names,
        "drawing_confidences": drawing_conf_vals,
        "drawing_sizes": drawing_sizes,
        "raw": data,
        "file": file_path
    }


# ============================================================
# MAIN COMPONENT EXECUTION
# ============================================================

status_messages = []

# ------------------------------------------------------------
# 1. Inputs
# ------------------------------------------------------------

capture_btn = get_input(
    "capture",
    "btn_capture",
    "capture_button",
    "button",
    "trigger",
    "refresh"
)

btn_pressed = as_bool(capture_btn)
status_messages.append(
    "DEBUG capture raw={} | pressed={}".format(
        repr(capture_btn),
        btn_pressed
    )
)
connect_enabled = as_bool(get_input("connect"))

raw_input = get_input(
    "json_path",
    "json_paths",
    "folder",
    "path",
    "file",
    "json"
)

sel_idx = as_int(
    get_input(
        "index",
        "selected_index"
    ),
    default=0
)

remote_host = get_input("host")

if remote_host is None or not str(remote_host).strip():

    remote_host = STREAM_HOST_DEFAULT

else:

    remote_host = str(remote_host).strip()

remote_port = as_int(
    get_input("port"),
    default=STREAM_PORT_DEFAULT
)


# ------------------------------------------------------------
# 2. File polling
# ------------------------------------------------------------

single_json_path = resolve_latest_json(
    raw_input
)

if single_json_path is not None:

    try:

        signature = file_signature(
            single_json_path
        )

        if signature != state.last_signature:

            with open(
                single_json_path,
                "r",
                encoding="utf-8"
            ) as f:

                loaded_data = json.load(f)

            if not isinstance(
                loaded_data,
                dict
            ):

                raise ValueError(
                    "Measurement JSON root must be an object."
                )

            # Successful read: update cached measurement.
            state.root_data = loaded_data
            state.last_signature = signature
            state.last_path = single_json_path
            state.last_loaded_at = time.time()
            state.last_error = ""

    except Exception as exc:

        # Preserve the previous valid measurement.
        state.last_error = str(exc)

        status_messages.append(
            "JSON read warning: " + str(exc)
        )

else:

    if state.root_data is None:

        status_messages.append(
            "WAITING: No measurement JSON found."
        )

    else:

        status_messages.append(
            "No new measurement file; using cached data."
        )


# ------------------------------------------------------------
# 3. Parse selected timber
# ------------------------------------------------------------

root_data = state.root_data

parsed_timber = None

active_file_path = state.last_path

capture_id_value = None

if root_data is not None:

    try:

        capture_id_value = root_data.get(
            "capture_id"
        )

        # Keep existing single-timber index selection.
        if (
            "timbers" in root_data
            and isinstance(root_data["timbers"], list)
            and len(root_data["timbers"]) > 0
        ):

            timber_list = root_data["timbers"]

            t_idx = sel_idx

            if (
                t_idx < 0
                or t_idx >= len(timber_list)
            ):

                t_idx = 0

            t_data = dict(
                timber_list[t_idx]
            )

        else:

            t_data = dict(
                root_data
            )

        # Inherit capture-level markers if needed.
        if (
            "markers_world_mm" in root_data
            and "markers_world_mm" not in t_data
        ):

            t_data["markers_world_mm"] = (
                root_data["markers_world_mm"]
            )

        parsed_timber = parse_single_timber(
            t_data,
            active_file_path
        )

    except Exception as exc:

        status_messages.append(
            "JSON parse error: " + str(exc)
        )


# ------------------------------------------------------------
# 4. Explicit stream connection and Save command
# ------------------------------------------------------------

# The 500 ms Grasshopper Timer still updates the JSON reader.
# It does not initiate a new connection on every evaluation.
# A failed connection is retried only after connect=False -> True.

client = state.client

if not connect_enabled:

    if client is not None:
        client.close()

    state.client = None
    state.client_host = None
    state.client_port = None
    state.connect_attempted = False
    state.connection_error = ""
    client = None

    status_messages.append("Stream: DISCONNECTED")

else:

    # On script reload, retain an already-registered client.
    if client is not None and client.running and client.registered:
        state.connect_attempted = True

    # Only one connection/registration attempt per True period.
    if not getattr(state, "connect_attempted", False):
        state.connect_attempted = True
        state.connection_error = ""

        try:
            client = get_stream_client(remote_host, remote_port)
        except Exception as exc:
            state.connection_error = str(exc)
            if state.client is not None:
                state.client.close()
            state.client = None
            state.client_host = None
            state.client_port = None
            client = None

    if client is not None and client.running and client.registered:
        status_messages.append("Stream: CONNECTED AND REGISTERED")

        if (state.client_host != remote_host or
                state.client_port != remote_port):
            status_messages.append(
                "Host/port changed; toggle connect False then True to apply"
            )

    elif state.connection_error:
        status_messages.append(
            "Stream connection error: " + state.connection_error
            + " (toggle False then True to retry)"
        )

    else:
        # An established connection may have dropped since registration.
        error = ""
        if client is not None:
            error = client.get_status().get("error", "")
        status_messages.append(
            "Stream: DISCONNECTED"
            + (" - " + error if error else "")
            + " (toggle False then True to reconnect)"
        )

# Save is never allowed without explicit connect=True and registration.
# The existing Button behavior is preserved (no rising-edge detection).
if btn_pressed:

    if (connect_enabled and client is not None
            and client.running and client.registered):
        try:
            request_id = client.send_save()
            status_messages.append("SAVE requested: " + request_id)
        except Exception as exc:
            status_messages.append("SAVE ERROR: " + str(exc))
    else:
        status_messages.append("SAVE BLOCKED: Controller not connected")

# Report the latest command result, only while the connection is enabled.
if connect_enabled and client is not None:

    client_status = client.get_status()
    result_message = client_status["result"]

    if result_message is not None:

        if result_message.get("success", False):
            result = result_message.get("result", {})
            saved_id = result.get(
                "entity_id", result.get("capture_id", "")
            )
            status_messages.append(
                "SAVE SUCCESS" + (": " + str(saved_id) if saved_id else "")
            )
        else:
            result = result_message.get("result", {})
            status_messages.append(
                "SAVE FAILED: " + str(result.get("error", "Unknown error"))
            )


# ------------------------------------------------------------
# 5. Table and marker geometry
# ------------------------------------------------------------

table_boundary = None
markers_corners_list = []

if IN_RHINO and rg is not None:

    if (
        root_data
        and "markers_world_mm" in root_data
    ):

        for m_id, m_info in (
            root_data["markers_world_mm"].items()
        ):

            if (
                "corners_mm" in m_info
                and len(m_info["corners_mm"]) == 4
            ):

                m_pts = [
                    rg.Point3d(
                        float(p[0]),
                        float(p[1]),
                        0.0
                    )
                    for p in m_info["corners_mm"]
                ]

                m_pts.append(m_pts[0])

                markers_corners_list.append(
                    rg.Polyline(
                        m_pts
                    ).ToPolylineCurve()
                )

    # Original physical table boundary.
    table_pts = [
        rg.Point3d(0.0, 0.0, 0.0),
        rg.Point3d(1780.0, 0.0, 0.0),
        rg.Point3d(1780.0, 1040.0, 0.0),
        rg.Point3d(0.0, 1040.0, 0.0),
        rg.Point3d(0.0, 0.0, 0.0)
    ]

    table_boundary = (
        rg.Polyline(table_pts).ToPolylineCurve()
    )


# ------------------------------------------------------------
# 6. Grasshopper outputs
# ------------------------------------------------------------

if parsed_timber is not None:

    timber_contour = timber_contours = make_grafted_tree([
        parsed_timber["contour"]
    ])

    timber_holes = inner_cuts = holes = make_grafted_tree([
        parsed_timber["holes"]
    ])

    timber_corners = corners = make_grafted_tree([
        parsed_timber["corners"]
    ])

    timber_id = timber_ids = make_grafted_tree([
        parsed_timber["timber_id"]
    ])

    length_mm = lengths_mm = make_grafted_tree([
        parsed_timber["length_mm"]
    ])

    width_mm = widths_mm = make_grafted_tree([
        parsed_timber["width_mm"]
    ])

    thickness_mm = thicknesses_mm = make_grafted_tree([
        parsed_timber["thickness_mm"]
    ])

    surface_area_cm2 = surface_areas_cm2 = make_grafted_tree([
        parsed_timber["surface_area_cm2"]
    ])

    side_lengths_mm = make_grafted_tree([
        parsed_timber["side_lengths_mm"]
    ])

    color_rgb = colors_rgb = make_grafted_tree([
        parsed_timber["color_rgb"]
    ])

    color_hex = colors_hex = make_grafted_tree([
        parsed_timber["color_hex"]
    ])

    defects = make_grafted_tree([
        parsed_timber["defects"]
    ])

    drawing_curves = hand_drawn_shapes = make_grafted_tree([
        parsed_timber["drawing_curves"]
    ])

    drawing_centers = make_grafted_tree([
        parsed_timber["drawing_centers"]
    ])

    drawing_classes = make_grafted_tree([
        parsed_timber["drawing_classes"]
    ])

    drawing_sizes = make_grafted_tree([
        parsed_timber["drawing_sizes"]
    ])

    drawing_confidences = make_grafted_tree([
        parsed_timber["drawing_confidences"]
    ])

    file_path = file_paths = make_grafted_tree([
        active_file_path
    ])

    raw_data = make_grafted_tree([
        parsed_timber["raw"]
    ])

    markers_corners = make_grafted_tree(
        markers_corners_list
    )

    # Capture-level entity ID.
    capture_id = capture_id_value

    fname = os.path.basename(
        active_file_path
    ) if active_file_path else ""

    drw_cls = parsed_timber[
        "drawing_classes"
    ]

    drw_str = (
        " | Drawings: " + ", ".join(drw_cls)
        if drw_cls else ""
    )

    info = (
        "Capture ID: {}\n"
        "Timber #{}: {:.1f} x {:.1f} mm, T={:.1f}mm{}\n"
        "File: {}"
    ).format(
        capture_id_value,
        parsed_timber["timber_id"],
        parsed_timber["length_mm"],
        parsed_timber["width_mm"],
        parsed_timber["thickness_mm"],
        drw_str,
        fname
    )

    if not status_messages:

        status_messages.append(
            "READY: Loaded " + fname
        )

else:

    timber_contour = timber_contours = make_grafted_tree([])
    timber_holes = inner_cuts = holes = make_grafted_tree([])
    timber_corners = corners = make_grafted_tree([])
    timber_id = timber_ids = make_grafted_tree([])
    length_mm = lengths_mm = make_grafted_tree([])
    width_mm = widths_mm = make_grafted_tree([])
    thickness_mm = thicknesses_mm = make_grafted_tree([])
    surface_area_cm2 = surface_areas_cm2 = make_grafted_tree([])
    side_lengths_mm = make_grafted_tree([])
    color_rgb = colors_rgb = make_grafted_tree([])
    color_hex = colors_hex = make_grafted_tree([])
    defects = make_grafted_tree([])
    drawing_curves = hand_drawn_shapes = make_grafted_tree([])
    drawing_centers = make_grafted_tree([])
    drawing_classes = make_grafted_tree([])
    drawing_sizes = make_grafted_tree([])
    drawing_confidences = make_grafted_tree([])
    file_path = file_paths = make_grafted_tree([])
    raw_data = make_grafted_tree([])

    markers_corners = make_grafted_tree(
        markers_corners_list
    )

    capture_id = capture_id_value

    info = (
        "Waiting for valid timber measurement."
    )

    if not status_messages:

        status_messages.append(
            "WAITING: No valid timber measurement."
        )


# ------------------------------------------------------------
# 7. Status output
# ------------------------------------------------------------

status = " | ".join(
    status_messages
)
# ---------- end timber_reader ----------
panel = Panel(timber_reader.status)
crv = Curve(timber_reader.timber_contour)
crv_2 = Curve(timber_reader.timber_holes)
crv_3 = Curve(timber_reader.table_boundary)
panel_2 = Panel(timber_reader.file_path)

# ----
# Live sender
crv_4 = Curve(crv)
number_slider = Slider(0, range=0..100)
swatch = ColourSwatch(SwatchColor=RGB(255, 0, 0))
swatch_2 = ColourSwatch(SwatchColor=RGB(0, 221, 255))
projector_live_sender = Python3Script(
    connect=connect,
    main_border=crv_4,
    timber_color=ColourSwatch(SwatchColor=RGB(255, 255, 255)),
    timber_width=number_slider,
    hand_drawing_color=ColourSwatch(SwatchColor=RGB(242, 227, 19)),
    cut_color=swatch,
    cut_thickness=number_slider,
    mill_color=swatch_2,
    mill_thickness=number_slider,
    point_color=swatch_2,
    label_color=swatch,
    label_scale=Slider(0.835, range=0..5),
    active=Toggle(True))  # -> status; inputs main_border: list of Curve, timber_color: Color, timber_width: tree of Int32, hand_drawing: list of Curve, hand_drawing_color: Color, cut: list of Curve, cut_color: list of Color, cut_thickness: Int32, mill: list of Curve, mill_thickness: Int32, points: list of Point3d, point_color: Color, drill_size: Int32, labels: list of String, label_points: list of Point3d, label_color: Color, label_scale: Double, thickness: Double, active: Boolean
# ---------- projector_live_sender: Python ----------
# eWoodX Grasshopper Python 3 projector sender (central stream host)
# NEW INPUT: connect (Boolean Toggle, Item Access)
# EXISTING INPUT: active (Boolean, Item Access) controls geometry publication
# host default 127.0.0.1; port default 6202 (projector channel)
# Keep all existing geometry inputs and the status output.
# A GH Timer may update geometry; it does NOT trigger reconnection.
# Grasshopper Python 3 sender.
# Add hand_drawing: Curve type hint, Tree access.
# Add hand_drawing_color: Colour type hint, Item access (Colour Swatch).
# Coordinates use the existing world XY convention; model units must be mm.
import math
import json
import socket
import time
import datetime
import threading
import scriptcontext as sc

# Rhino imports with safe fallback for testing
try:
    import Rhino.Geometry as rg
    import System.Drawing as sd
    IN_RHINO = True
except ImportError:
    rg = None
    sd = None
    IN_RHINO = False


# ============================================================
# DATATREE & SCALAR EXTRACTION HELPERS
# ============================================================

def flatten_input(val):
    """Recursively flatten any Grasshopper DataTree, list, or nested collection."""
    if val is None:
        return []
    if hasattr(val, "AllData"):
        try:
            return list(val.AllData())
        except Exception:
            pass
    if hasattr(val, "Branches"):
        try:
            out = []
            for b in val.Branches:
                for item in b:
                    out.append(item)
            return out
        except Exception:
            pass
    if isinstance(val, (list, tuple)):
        out = []
        for item in val:
            if isinstance(item, (list, tuple)) or hasattr(item, "AllData") or hasattr(item, "Branches"):
                out.extend(flatten_input(item))
            else:
                out.append(item)
        return out
    return [val]


def extract_single_scalar(val, default=None):
    """Safely extract a single scalar from any DataTree, list, or primitive."""
    if val is None:
        return default
    if isinstance(val, (int, float, bool)):
        return val
    if isinstance(val, str):
        try:
            return val.strip().strip('"').strip("'")
        except Exception:
            return val

    # 1. Try AllData
    if hasattr(val, "AllData"):
        try:
            for item in val.AllData():
                res = extract_single_scalar(item, None)
                if res is not None:
                    return res
        except Exception:
            pass

    # 2. Try Branches
    if hasattr(val, "Branches"):
        try:
            for b in val.Branches:
                for item in b:
                    res = extract_single_scalar(item, None)
                    if res is not None:
                        return res
        except Exception:
            pass

    # 3. Try Branch(0)
    if hasattr(val, "Branch"):
        try:
            b = val.Branch(0)
            if len(b) > 0:
                return extract_single_scalar(b[0], default)
        except Exception:
            pass

    # 4. Try indexing or iteration
    try:
        for item in val:
            res = extract_single_scalar(item, None)
            if res is not None:
                return res
    except Exception:
        pass

    try:
        return val[0]
    except Exception:
        pass

    return default


def to_int(val, default_val=0):
    """Convert any DataTree, string, float, or integer to a clean integer."""
    if val is None:
        return default_val
    scalar = extract_single_scalar(val, None)
    if scalar is None:
        return default_val
    try:
        return int(float(str(scalar).strip().strip('"').strip("'")))
    except (ValueError, TypeError):
        return default_val


def to_float(val, default_val=None):
    """Convert any DataTree, string, or number to a clean float."""
    if val is None:
        return default_val
    scalar = extract_single_scalar(val, None)
    if scalar is None:
        return default_val
    try:
        return float(str(scalar).strip().strip('"').strip("'"))
    except (ValueError, TypeError):
        return default_val



def to_bool(val, default_val=True):
    """Convert any DataTree or value to boolean."""
    scalar = extract_single_scalar(val, default_val)
    if scalar is None:
        return default_val
    if isinstance(scalar, bool):
        return scalar
    s_str = str(scalar).strip().lower()
    return s_str in ("true", "1", "yes", "on")


def extract_rgb(color_in, default_rgb=None):
    """Read a swatch, GH_Colour, tree, RGB tuple, or six-digit hex."""
    fallback = list(default_rgb if default_rgb is not None else [255, 255, 255])
    if color_in is None:
        return fallback
    if hasattr(color_in, "Value"):
        return extract_rgb(color_in.Value, fallback)
    if all(hasattr(color_in, channel) for channel in ("R", "G", "B")):
        return [int(color_in.R), int(color_in.G), int(color_in.B)]
    if isinstance(color_in, str):
        value = color_in.strip().strip('"').strip("'").lstrip("#")
        if len(value) == 6:
            try:
                return [int(value[i:i + 2], 16) for i in (0, 2, 4)]
            except ValueError:
                pass
        return fallback
    if isinstance(color_in, (list, tuple)) and len(color_in) >= 3:
        try:
            return [max(0, min(255, int(v))) for v in color_in[:3]]
        except (ValueError, TypeError, OverflowError):
            pass
    items = flatten_input(color_in)
    if items and items[0] is not color_in:
        return extract_rgb(items[0], fallback)
    return fallback


def curve_to_polyline_pts(curve_obj, max_chord_error=0.5):
    """Convert any Rhino Curve, Line, Arc, or Polyline into a list of [X, Y] points (mm)."""
    if curve_obj is None:
        return []

    if hasattr(curve_obj, "Value"):
        curve_obj = curve_obj.Value

    # If already a list of points or raw coordinate lists
    if isinstance(curve_obj, (list, tuple)):
        if len(curve_obj) > 0 and isinstance(curve_obj[0], (list, tuple, rg.Point3d if rg else tuple)):
            pts_out = []
            for p in curve_obj:
                if hasattr(p, "Value"):
                    p = p.Value
                if hasattr(p, "X") and hasattr(p, "Y"):
                    pts_out.append([round(float(p.X), 2), round(float(p.Y), 2)])
                elif isinstance(p, (list, tuple)) and len(p) >= 2:
                    pts_out.append([round(float(p[0]), 2), round(float(p[1]), 2)])
            return pts_out

    if not IN_RHINO or rg is None:
        return []

    # If Rhino Curve
    if isinstance(curve_obj, rg.Curve):
        pline_try = None
        success, pline = curve_obj.TryGetPolyline()
        if success and pline is not None:
            return [[round(p.X, 2), round(p.Y, 2)] for p in pline]

        poly_curve = curve_obj.ToPolyline(max_chord_error, 0.1, 0.0, 0.0)
        if poly_curve:
            return [[round(poly_curve.Point(i).X, 2), round(poly_curve.Point(i).Y, 2)] for i in range(poly_curve.PointCount)]

        div_count = max(8, int(curve_obj.GetLength() / 5.0))
        params = curve_obj.DivideByCount(div_count, True)
        if params:
            return [[round(curve_obj.PointAt(t).X, 2), round(curve_obj.PointAt(t).Y, 2)] for t in params]

    elif isinstance(curve_obj, rg.Line):
        return [
            [round(curve_obj.From.X, 2), round(curve_obj.From.Y, 2)],
            [round(curve_obj.To.X, 2), round(curve_obj.To.Y, 2)]
        ]

    elif isinstance(curve_obj, rg.Polyline):
        return [[round(p.X, 2), round(p.Y, 2)] for p in curve_obj]

    return []


def closed_curve_to_polygon(curve_obj):
    """Project a closed curve to world XY; return a closed polygon ring."""
    if hasattr(curve_obj, "Value"):
        curve_obj = curve_obj.Value
    if curve_obj is None or not bool(getattr(curve_obj, "IsClosed", False)):
        return []
    if not bool(getattr(curve_obj, "IsValid", True)):
        return []
    pts = curve_to_polyline_pts(curve_obj)
    ring = []
    for pt in pts:
        if not all(math.isfinite(v) for v in pt):
            return []
        if not ring or pt != ring[-1]:
            ring.append(pt)
    if len(ring) > 1 and ring[-1] == ring[0]:
        ring.pop()
    if len(set(tuple(pt) for pt in ring)) < 3:
        return []
    # Reject rings that collapse to a line after projection / rounding.
    a = ring[0]
    b = next(pt for pt in ring[1:] if pt != a)
    if not any(abs((b[0] - a[0]) * (p[1] - a[1]) -
                   (b[1] - a[1]) * (p[0] - a[0])) > 1e-10 for p in ring[2:]):
        return []
    ring.append(list(ring[0]))
    return ring


def point_to_xy(pt_obj):
    """Extract [X, Y] in mm from Point3d or coordinate list."""
    if pt_obj is None:
        return None
    if hasattr(pt_obj, "Value"):
        pt_obj = pt_obj.Value
    if hasattr(pt_obj, "Location"):
        pt_obj = pt_obj.Location
    if hasattr(pt_obj, "X") and hasattr(pt_obj, "Y"):
        return [round(float(pt_obj.X), 2), round(float(pt_obj.Y), 2)]
    if isinstance(pt_obj, (list, tuple)) and len(pt_obj) >= 2:
        return [round(float(pt_obj[0]), 2), round(float(pt_obj[1]), 2)]
    return None


# ============================================================
# CENTRAL eWoodX STREAM CONNECTION SETTINGS
# ============================================================
HOST = "127.0.0.1"
PORT = 6202
HEADER_SIZE = 8
CONNECT_TIMEOUT = 2.0
REGISTRATION_TIMEOUT = 3.0


def component_id():
    try:
        return str(ghenv.Component.InstanceGuid).replace("-", "")[:12]
    except Exception:
        return "default"


class ProjectorSenderState:
    def __init__(self):
        self.client = None
        self.connect_attempted = False
        self.connection_error = ""
        self.host = None
        self.port = None


STATE_KEY = "ewoodx_gh_projector_sender_" + component_id()
if STATE_KEY not in sc.sticky:
    sc.sticky[STATE_KEY] = ProjectorSenderState()
state = sc.sticky[STATE_KEY]


class ProjectorStreamClient:
    """Persistent, registered eWoodX TCP client; receive thread detects closure."""

    def __init__(self, host, port, agent_id):
        self.host = host
        self.port = int(port)
        self.agent_id = agent_id
        self.sock = None
        self.running = False
        self.registered = False
        self.last_error = ""
        self.registration_event = threading.Event()
        self.lock = threading.RLock()
        self.send_lock = threading.Lock()
        self.thread = None

    def _send(self, message):
        data = json.dumps(message, allow_nan=False).encode("utf-8")
        frame = len(data).to_bytes(HEADER_SIZE, "big") + data
        with self.send_lock:
            if not self.running or self.sock is None:
                raise ConnectionError("Stream socket is disconnected")
            self.sock.sendall(frame)

    def _read_exact(self, count):
        chunks = []
        while count:
            chunk = self.sock.recv(count)
            if not chunk:
                raise ConnectionError("Stream socket closed by host")
            chunks.append(chunk)
            count -= len(chunk)
        return b"".join(chunks)

    def _receive_loop(self):
        try:
            while self.running:
                length = int.from_bytes(self._read_exact(HEADER_SIZE), "big")
                if not 0 < length <= 10 * 1024 * 1024:
                    raise ValueError("Invalid stream frame length")
                message = json.loads(self._read_exact(length).decode("utf-8"))
                kind = message.get("type")
                if kind == "agent_registered":
                    with self.lock:
                        if message.get("agent_id") == self.agent_id:
                            self.registered = True
                        else:
                            self.last_error = "Registration agent ID mismatch"
                    self.registration_event.set()
                elif kind == "agent_rejected":
                    with self.lock:
                        self.last_error = str(message.get("reason", "Registration rejected"))
                        self.registered = False
                    self.registration_event.set()
        except Exception as exc:
            with self.lock:
                if self.running:
                    self.last_error = str(exc)
        finally:
            self.close()

    def connect(self):
        sock = socket.socket(socket.AF_INET, socket.SOCK_STREAM)
        try:
            sock.settimeout(CONNECT_TIMEOUT)
            sock.connect((self.host, self.port))
            sock.settimeout(None)
        except Exception:
            sock.close()
            raise
        with self.lock:
            self.sock = sock
            self.running = True
            self.registered = False
            self.registration_event.clear()
        self.thread = threading.Thread(target=self._receive_loop, daemon=True)
        self.thread.start()
        try:
            self._send({
                "type": "agent_register",
                "agent": {
                    "agent_id": self.agent_id,
                    "roles": ["projector"],
                    "metadata": {"application": "grasshopper", "component": "projector_sender"}
                }
            })
            if not self.registration_event.wait(REGISTRATION_TIMEOUT):
                raise TimeoutError("Registration acknowledgment timed out")
            with self.lock:
                if not self.registered:
                    raise ConnectionError(self.last_error or "Registration failed")
        except Exception:
            self.close()
            raise

    def publish(self, payload):
        with self.lock:
            if not self.running or not self.registered:
                raise ConnectionError("Projector sender not registered")
        self._send({
            "type": "ewoodx.projector",
            "timestamp": time.time(),
            "payload": payload
        })

    def close(self):
        with self.lock:
            self.running = False
            self.registered = False
            sock = self.sock
            self.sock = None
            self.registration_event.set()
        if sock is not None:
            try:
                sock.shutdown(socket.SHUT_RDWR)
            except Exception:
                pass
            try:
                sock.close()
            except Exception:
                pass


# ============================================================
# ============================================================
# MAIN SENDER EXECUTION
# ============================================================

# 1. Inputs with defaults
is_active = to_bool(globals().get("active", True), True)
connect_enabled = to_bool(globals().get("connect", False), False)

raw_host = extract_single_scalar(globals().get("host", None))
if raw_host is not None:
    cleaned_host = str(raw_host).strip().strip('"').strip("'")
    if cleaned_host in ("0.0.0.0", "", "None", "localhost", "0"):
        target_host = HOST
    else:
        target_host = cleaned_host
else:
    target_host = HOST

target_port = to_int(globals().get("port", PORT), PORT)

# Explicit connection lifecycle: one attempt per False -> True activation.
# No reconnect attempts during GH timer evaluations.
if not connect_enabled:
    if state.client is not None:
        state.client.close()
    state.client = None
    state.host = None
    state.port = None
    state.connect_attempted = False
    state.connection_error = ""
elif not getattr(state, "connect_attempted", False):
    state.connect_attempted = True
    state.connection_error = ""
    client = ProjectorStreamClient(
        target_host, target_port,
        "ewoodx_gh_projector_" + component_id()
    )
    try:
        client.connect()
        state.client = client
        state.host = target_host
        state.port = target_port
    except Exception as exc:
        state.connection_error = str(exc)
        client.close()
        state.client = None

client = state.client
stream_ready = bool(
    connect_enabled and client is not None
    and client.running and client.registered
)
if not connect_enabled:
    connection_status = "Stream: DISCONNECTED"
elif stream_ready:
    connection_status = "Stream: CONNECTED AND REGISTERED"
    if state.host != target_host or state.port != target_port:
        connection_status += " (host/port changed; toggle connect to apply)"
else:
    error = state.connection_error or (client.last_error if client is not None else "")
    connection_status = "Stream: DISCONNECTED" + (" - " + error if error else "")
    connection_status += " (toggle connect False then True to retry)"


timber_input = globals().get("main_border", None)
timber_col_in = globals().get("timber_color", None)
timber_rgb = extract_rgb(timber_col_in, [255, 255, 255])

cut_input = globals().get("cut", [])
cut_col_in = globals().get("cut_color", None)
cut_rgb = extract_rgb(cut_col_in, [255, 30, 30])

mill_input = globals().get("mill", [])
mill_col_in = globals().get("mill_color", None)
mill_rgb = extract_rgb(mill_col_in, [0, 220, 255])

points_input = globals().get("points", [])
pt_col_in = globals().get("point_color", None)
point_rgb = extract_rgb(pt_col_in, [0, 255, 100])

labels_input = globals().get("labels", [])
label_pts_input = globals().get("label_points", [])
label_col_in = globals().get("label_color", None)
label_rgb = extract_rgb(label_col_in, [255, 180, 0])

hand_drawing_input = globals().get("hand_drawing", [])
hand_drawing_rgb = extract_rgb(globals().get("hand_drawing_color", None), [255, 255, 255])

thickness_val = to_float(globals().get("thickness", None), None)

if not is_active:
    status = "Paused (active = False) | " + connection_status
else:
    # ============================================================
    # 2. PROCESS MULTIPLE TIMBER CONTOURS
    # ============================================================

    contour_list = []

    if timber_input is not None:

        flat_timber = flatten_input(
            timber_input
        )

        for item in flat_timber:

            pts = curve_to_polyline_pts(
                item
            )

            if pts and len(pts) >= 3:

                # IMPORTANT:
                # append keeps every timber as a separate contour
                contour_list.append(
                    pts
                )

    # 3. Process Cut Curves (supports list or grafted DataTree)
    cut_list = []
    if cut_input is not None:
        flat_cuts = flatten_input(cut_input)
        for item in flat_cuts:
            pts = curve_to_polyline_pts(item)
            if pts and len(pts) >= 2:
                cut_list.append(pts)

    # 4. Process Mill Curves (supports list or grafted DataTree)
    mill_list = []
    if mill_input is not None:
        flat_mills = flatten_input(mill_input)
        for item in flat_mills:
            pts = curve_to_polyline_pts(item)
            if pts and len(pts) >= 2:
                mill_list.append(pts)

    # 5. Process Drill / Alignment Points (supports list or grafted DataTree)
    pts_list = []
    if points_input is not None:
        flat_pts = flatten_input(points_input)
        for item in flat_pts:
            xy = point_to_xy(item)
            if xy:
                pts_list.append(xy)

    # 6. Process Labels
    label_items = []
    if labels_input is not None:
        flat_labels = flatten_input(labels_input)
        flat_pos = flatten_input(label_pts_input) if label_pts_input is not None else []

        for i, txt in enumerate(flat_labels):
            if txt:
                pos = [200, 200]
                if i < len(flat_pos) and flat_pos[i]:
                    xy = point_to_xy(flat_pos[i])
                    if xy:
                        pos = xy
                label_items.append({"text": str(txt), "pos": pos})

    # 7. Stroke Thicknesses & Sizes (Safely unwraps any DataTree / Int32 / float slider)
    cut_th = to_int(globals().get("cut_thickness", globals().get("cut_width", 3)), 3)
    mill_th = to_int(globals().get("mill_thickness", globals().get("mill_width", 2)), 2)
    timber_th = to_int(globals().get("timber_thickness_px", globals().get("timber_width", 2)), 2)
    drill_rad = to_int(globals().get("drill_size", globals().get("point_size", globals().get("drill_radius", 6))), 6)
    label_sz = to_float(globals().get("label_scale", globals().get("text_size", 0.45)), 0.45)

    # Filled hand drawing: each closed curve is an independent solid polygon.
    hand_drawing_list = []
    hand_drawing_skipped = 0
    for item in flatten_input(hand_drawing_input):
        try:
            polygon = closed_curve_to_polygon(item)
        except Exception:
            polygon = []
        if polygon:
            hand_drawing_list.append(polygon)
        else:
            hand_drawing_skipped += 1

    # 8. Construct Payload
    payload = {
        "timestamp": time.time(),
        "hand_drawing_geo": hand_drawing_list,
        "hand_drawing_color": hand_drawing_rgb,
        "hand_drawing_fill": True,
        "thickness_mm": thickness_val,
        "timber_contour": contour_list,
        "timber_color": timber_rgb,
        "timber_thickness_px": timber_th,
        "cut_geo": cut_list,
        "cut_color": cut_rgb,
        "cut_thickness_px": cut_th,
        "mill_geo": mill_list,
        "mill_color": mill_rgb,
        "mill_thickness_px": mill_th,
        "points_geo": pts_list,
        "point_color": point_rgb,
        "drill_radius_px": drill_rad,
        "labels": label_items,
        "label_color": label_rgb,
        "label_scale": label_sz
    }

    # 9. Publish the unchanged projector payload through the central host.
    # The host forwards ewoodx.projector to subscribed ProjectorStreamService.
    if not stream_ready:
        status = "Geometry not sent | " + connection_status
    else:
        try:
            client.publish(payload)
            now_str = datetime.datetime.now().strftime("%H:%M:%S")
            status = (
                f"[LIVE OK {now_str}] -> {target_host}:{target_port} | "
                f"Contours: {len(contour_list)} | Cuts: {len(cut_list)} | "
                f"Mills: {len(mill_list)} | Holes: {len(pts_list)} | Labels: {len(label_items)} | "
                f"Filled drawings: {len(hand_drawing_list)} | Skipped drawings: {hand_drawing_skipped} | "
                + connection_status
            )
        except Exception as exc:
            status = "Geometry send error: " + str(exc) + " | " + connection_status
# ---------- end projector_live_sender ----------
panel_3 = Panel(projector_live_sender)
